# Grasshopper definition Automated_slew_check_script.gh (Grasshopper 1.0.7)
# Copyright: Arup
# plug-ins: Wombat, treesloth01, CORE.Toolbox.Grasshopper, LunchBox

# ----
# Path to Output file
# Double Click when ready to send output
python = GhPythonScript()  # -> out, a
# ---------- python: Python ----------
__author__ = "Mohammed.Hashem"
__version__ = "2024.05.10"

import rhinoscriptsyntax as rs
file_name = ghenv.Component.OnPingDocument().FilePath
a=file_name
# ---------- end python ----------
cluster = Cluster_3(directory_path=python.a, file_name="Automation_script_output.xlsx")
send_to_excel = BooleanToggle(False)
panel = Panel(cluster)

# ----
# Input Target Chainages
# (copy from excel, remove '+')
target_chainage = Panel("47130")

# ----
# LSE - Extracting curves from DWG
panel_2 = Panel("""C-RAIL-ALGN-N
C-RAIL-ALGN-STG-M
C-RAIL-ALGN-STG-E-O
C-RAIL-ALGN-STG-N-ENB
C-RAIL-ALGN-N-FOCUSED""")
panel_3 = Panel("""C-ROAD-CNTR-N
C-ROAD-CNTR-M""")
layer_ref = LayerReference(ReferenceToggle=True, LayerName=panel_2)  # -> flatten(Geometry), Name, UserStrings, GUID
layer_ref_2 = LayerReference(ReferenceToggle=True, LayerName=panel_3)  # -> flatten(Geometry), Name, UserStrings, GUID

# ----
# LSE - Setting baseline for chainage reading
cluster_2 = Cluster_2(all_new_tracks=layer_ref.Geometry)

continuous_new_track = Curve(cluster_2)
calibration = Panel("50930.7")

len = Length(Curve=continuous_new_track)
panel_4 = Panel(len)

all_existing_tracks = Curve(layer_ref_2.Geometry)
all_new_tracks = Curve(layer_ref.Geometry)

# ----
# LSW - Setting baseline for chainage reading
t1_6_2 = Curve([<curve referenced from the Rhino model> x28])
join = JoinCurves(Curves=t1_6_2, Preserve=False)
join_2 = JoinCurves(Curves=join, Preserve=False)
len_2 = Length(Curve=join_2)
sort = SortList(Keys=len_2, ValuesA=join_2)  # -> reverse(Keys), reverse(ValuesA)
split = SplitList(List=sort.ValuesA, Index=1)  # -> ListA, ListB
flip = FlipCurve(Curve=split.ListA)  # -> Curve, Flag

# ----
# LSW - Extracting curves from DWG
panel_5 = Panel("2023.11.30_OnCorr_LSW_Exist_Track_(2D)$0$Oakville Existing TOR Groma 2022_(2D)_C-TRACK-CNTR")
layer_ref_3 = LayerReference(ReferenceToggle=True, LayerName=panel_5)  # -> flatten(Geometry), Name, UserStrings, GUID

panel_6 = Panel("""2024.03.29_OnCorr_Track_Baseline_6.2_LSW_Oakville_(2D)$0$C-RAIL-ALGN-E
2024.03.29_OnCorr_Track_Baseline_6.2_LSW_Oakville_(2D)$0$C-RAIL-ALGN-STG-N-ENB-C5
2024.03.29_OnCorr_Track_Baseline_6.2_LSW_Oakville_(2D)$0$C-RAIL-ALGN-N-FOCUSED
2024.03.29_OnCorr_Track_Baseline_6.2_LSW_Oakville_(2D)$0$C-RAIL-ALGN-N1
2024.03.29_OnCorr_Track_Baseline_6.2_LSW_Oakville_(2D)$0$C-RAIL-ALGN-STG-M""")
layer_ref_4 = LayerReference(ReferenceToggle=True, LayerName=panel_6)  # -> flatten(Geometry), Name, UserStrings, GUID
join_3 = JoinCurves(Curves=layer_ref_3.Geometry, Preserve=False)
join_4 = JoinCurves(Curves=layer_ref_4.Geometry, Preserve=False)

number_slider = Slider(7, range=0..55)
number_slider_2 = Slider(0, range=0..6)

t1_calibration = Panel("51480")
t1_6_2_2 = Curve(flip.Curve)

all_existing_tracks_2 = Curve(join_3)
all_new_tracks_2 = Curve(join_4)

# ----
# Filter LSE or LSW values
lsw = BooleanToggle(False)
filter = StreamFilter(Gate=lsw, Stream0=target_chainage, Stream1=reverse(target_chainage))
filter_2 = StreamFilter(Gate=lsw, Stream0=all_new_tracks, Stream1=all_new_tracks_2)
filter_3 = StreamFilter(Gate=lsw, Stream0=all_existing_tracks, Stream1=all_existing_tracks_2)
filter_4 = StreamFilter(Gate=lsw, Stream0=calibration, Stream1=t1_calibration)
filter_5 = StreamFilter(Gate=lsw, Stream0=continuous_new_track, Stream1=t1_6_2_2)

all_new_tracks_3 = Curve(filter_2)
all_existing_tracks_3 = Curve(filter_3)
continuous_new_track_2 = Curve(filter_5)
calibration_chainage = Data(filter_4)
target_chainage_2 = Data(filter)

# ----
# Measuring chainage and setting perpendicular lines for readings
subtraction = Subtraction(TargetChainage=target_chainage_2, CalibrationChainage=calibration_chainage)
abs = Absolute(Value=subtraction)
eval = EvaluateLength(ContNewTrack=continuous_new_track_2, Length=abs, Normalized=False)  # -> Point, Tangent, Parameter
xy = XYPlane(Origin=eval.Point)
line = LineSDL(Start=eval.Point, Direction=eval.Tangent, Length=50)
rotate = Rotate(Geometry=line, Angle=1.570796327, Plane=xy)  # -> Geometry, Transform
rotate_2 = Rotate(Geometry=line, Angle=-1.570796327, Plane=xy)  # -> Geometry, Transform
join_5 = JoinCurves(Curves=[rotate.Geometry, rotate_2.Geometry], Preserve=False)
intersection_lines_at_chainage = Curve(join_5)

item = ListItem(List=eval.Point, Index=Slider(12, range=0..33), Wrap=True)
len_3 = Length(Curve=t1_6_2_2)
panel_7 = Panel(len_3)

# ----
# Old Method - Ignore - Does not work
pipeline = GeometryPipeline(
    GroupByLayer=False,
    GroupByType=False,
    IncludeHidden=True,
    IncludeLocked=True,
    LayerFilter="2023.11.30_OnCorr_LSW_Exist_Track_(2D)$0$Oakville Existing TOR Groma 2022_(2D)_C-TRACK-CNTR",
    NameFilter="*",
    SublayerFiltering=True,
    TypeFilter=4)  # disabled
t1_6_2_3 = Curve([<curve referenced from the Rhino model> x28])  # disabled
t2_6_2 = Curve([<curve referenced from the Rhino model> x37])  # disabled
join_6 = JoinCurves(Curves=t1_6_2_3, Preserve=False)  # disabled
join_7 = JoinCurves(Curves=t2_6_2, Preserve=False)  # disabled
join_8 = JoinCurves(Curves=pipeline, Preserve=False)  # disabled
join_9 = JoinCurves(Curves=join_6, Preserve=False)  # disabled
join_t = JoinCurvesWithTolerance(Curves=join_7, Tolerance=100, Option=0)  # disabled
len_4 = Length(Curve=join_8)  # disabled
sort_2 = SortList(Keys=len_4, ValuesA=join_8)  # -> reverse(Keys), reverse(ValuesA); disabled
len_5 = Length(Curve=join_9)  # disabled
len_6 = Length(Curve=join_t)  # disabled
item_2 = ListItem(List=sort_2.ValuesA, Index=0, Wrap=True)  # -> Item, Item1, Item2, Item3, Item4; disabled
sort_3 = SortList(Keys=len_6, ValuesA=join_t)  # -> reverse(Keys), reverse(ValuesA); disabled
sort_4 = SortList(Keys=len_5, ValuesA=join_9)  # -> reverse(Keys), reverse(ValuesA); disabled
item_3 = ListItem(List=sort_3.ValuesA, Index=0, Wrap=True)  # disabled
split_2 = SplitList(List=sort_4.ValuesA, Index=1)  # -> ListA, ListB; disabled
number_slider_3 = Slider(15, range=0..55)  # disabled
target_chainage_3 = Panel("""3250
6260
6710
7290
7560
7850
7880
8100
8300
8560
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""")  # disabled

ex_t3 = Curve(item_2.Item)  # disabled
ex_t1 = Curve(item_2.Item1)  # disabled
ex_t4 = Curve(item_2.Item3)  # disabled
ex_t2 = Curve(item_2.Item2)  # disabled

t2_calibration = Panel("2466.6")  # disabled
t2_6_2_2 = Curve(item_3)  # disabled

t1_calibration_2 = Panel("2467.75")  # disabled
t1_6_2_4 = Curve(split_2.ListA)  # disabled

entwine = Entwine(Branch00=t1_calibration_2, Branch01=t2_calibration, FlattenInputs=True)  # disabled
entwine_2 = Entwine(Branch00=t1_6_2_4, Branch01=t2_6_2_2, FlattenInputs=True)  # disabled
entwine_3 = Entwine(Branch00=ex_t1, Branch01=ex_t2, FlattenInputs=True)  # disabled
subtraction_2 = Subtraction(A=target_chainage_3, B=entwine)  # disabled
eval_2 = EvaluateLength(Curve=entwine_2, Length=subtraction_2, Normalized=False)  # -> Point, Tangent, Parameter; disabled
crv_cp = CurveClosestPoint(Point=eval_2.Point, Curve=entwine_3)  # -> Point, Parameter, Distance; disabled
item_4 = ListItem(List=eval_2.Point, Index=number_slider_3, Wrap=True)  # disabled
dist = Distance(PointA=eval_2.Point, PointB=crv_cp.Point)  # disabled
flip_2 = FlipMatrix(Data=dist)  # disabled

# ----
# Finding exact points at target chainage for new and old tracks
ccx = CurveCurve(ChainageLines=graft(intersection_lines_at_chainage), AllNewTracks=all_new_tracks_3)  # -> Points, ParamsA, ParamsB
ccx_2 = CurveCurve(ChainageLines=graft(intersection_lines_at_chainage), ExistingTracks=all_existing_tracks_3)  # -> flatten(Points), ParamsA, ParamsB
simplify = SimplifyTree(Tree=ccx.Points, Front=False)
clean = CleanTree(RemoveNulls=True, RemoveInvalid=True, RemoveEmpty=True, Tree=simplify)
shift = ShiftPaths(Data=clean, Offset=-1)
cluster_3 = Cluster(unsorted=shift)

branch = TreeBranch(Tree=cluster_3, Path=number_slider, MaintainPaths=True)
item_5 = ListItem(List=branch, Index=number_slider_2, Wrap=True)

col_title_ensure_same_length_as_data = Panel("""Chainage
New T1 (mm)
New T2 (mm)
New T3 (mm)
New T4 (mm)
New T5 (mm)""")

points_on_new_alignment = Data(cluster_3)

cp = ClosestPoint(NewTrackPoints=points_on_new_alignment, Cloud=ccx_2.Points)  # -> ClosestPoint, CPIndex, Distance
cluster_4 = Cluster(unsorted=cp.ClosestPoint)

closest_points_on_existing = Data(cluster_4)

# ----
# Output track offsets into excel
# (N -> S tracks, +ve=Moved North)
pdecon = Deconstruct(NewPoints=points_on_new_alignment)  # -> XComponent, YComponent, ZComponent
pdecon_2 = Deconstruct(ExPoints=closest_points_on_existing)  # -> XComponent, YComponent, ZComponent
dist_2 = Distance(NewPoints=points_on_new_alignment, ExTPoints=closest_points_on_existing)
expression = Expression(x=pdecon.YComponent, y=pdecon_2.YComponent, Expression="x<y")
multiplication = Multiplication(A=expression, B=-1)
replace = ReplaceMembers(Set=multiplication, Find=0, Replace=1)
multiplication_2 = Multiplication(A=replace, B=dist_2, _1000=1000)
flip_3 = FlipMatrix(Data=multiplication_2)
nullrep = ReplaceNulls(Items=flip_3, Replacements="0")  # -> Items, Count
stack = StackTrees(Data0=target_chainage_2, Data1=nullrep.Items, Reduce=True)
flip_4 = FlipMatrix(Data=stack)
stack_2 = StackTrees(Data0=col_title_ensure_same_length_as_data, Data1=flip_4, Reduce=True)

panel_8 = Panel(flip_4)
xl_out = WriteToExcelClassic(WorkbookFilepath=panel, Data=stack_2, LocationAddress="A1", Clear=0, Stream=send_to_excel)

# ----
# Display chianage
lng = ListLength(List=target_chainage_2)
series = Series(Start=0, Step=1, Count=lng)
filter_6 = StreamFilter(Gate=lsw, Stream0=series, Stream1=reverse(series))
concat = Concatenate(FragmentC="(", FragmentA=filter_6, FragmentD=") ", FragmentB=target_chainage_2)  # -> graft(Result)
item_6 = ListItem(List=closest_points_on_existing, Index=0, Wrap=True)
end = EndPoints(Curve=intersection_lines_at_chainage)  # -> Start, End
cp_2 = ClosestPoint(Point=item_6, Cloud=end.Start)  # -> ClosestPoint, CPIndex, Distance
tag = TextTag(Location=cp_2.ClosestPoint, Text=concat)

branch_2 = TreeBranch(Tree=closest_points_on_existing, Path=number_slider, MaintainPaths=True)
item_7 = ListItem(List=branch_2, Index=number_slider_2, Wrap=True)

# ==== cluster Cluster
unsorted = ClusterInput()
unsorted_2 = Data(unsorted)
pdecon = Deconstruct(Unsorted=unsorted_2)  # -> XComponent, YComponent, ZComponent
sort = SortList(Keys=pdecon.YComponent, ValuesA=unsorted_2)  # -> Keys, ValuesA
item = ListItem(List=reverse(sort.ValuesA), Index=0, Wrap=True)
shift = ShiftPaths(Data=item, Offset=-1)
sort_pt = SortPoints(Points=shift)  # -> Points, Indices
path = ConstructPath(Indices=graft(sort_pt.Indices))
shift_2 = ShiftPaths(Data=path, Offset=-1)
branch = TreeBranch(Tree=reverse(sort.ValuesA), Path=shift_2, MaintainPaths=False)
sorted = ClusterOutput(branch)

# ==== cluster Cluster_2
all_new_tracks = ClusterInput()
join = JoinCurves(AllNewTracks=all_new_tracks, Preserve=False)
len = Length(Curve=join)
sort = SortList(Keys=len, ValuesA=join)  # -> reverse(Keys), reverse(ValuesA)
panel = Panel("""0
2""")
item = ListItem(List=sort.ValuesA, Index=panel, Wrap=True)
item_2 = ListItem(List=sort.ValuesA, Index=Slider(2, range=0..30), Wrap=True)
crv = Curve([<curve referenced from the Rhino model> x7])
crv_2 = Curve(item)
join_2 = JoinCurves(Curves=crv_2, Preserve=False)  # -> flatten(Curves)
join_t = JoinCurvesWithTolerance(Curves=join_2, Tolerance=100, Option=0)
flip = FlipCurve(Curve=join_t)  # -> ContinuousTrack, Flag
continuous_track = ClusterOutput(flip.ContinuousTrack)

# ==== cluster Cluster_3
directory_path = ClusterInput()
directory_path_2 = Data(directory_path)
panel = Panel(directory_path_2)
file_name = ClusterInput()
split = TextSplit(Text=panel, Separators="\")
file_name_2 = Data(file_name)
lng = ListLength(List=split)
subtraction = Subtraction(A=lng, B=1)
split_2 = SplitList(List=split, Index=subtraction)  # -> ListA, ListB
join = TextJoin(Text=flatten(split_2.ListA), Join="\")
join_2 = TextJoin(Text=flatten([join, file_name_2]), Join="\")
file_path = ClusterOutput(join_2)
